# Grasshopper definition 6ae7022f.gh (Grasshopper 1.0.8)
# plug-ins: MetaHopper, UiPlus, Sasquatch

spacer = UiSpacer(Width=10, Horizontal=False)
subtraction = Subtraction(B=30)
pt = Point(Point(0, 0, 0))
brep = Brep(<brep referenced from the Rhino model>)
brep_2 = Brep(<brep referenced from the Rhino model>)
geo = Geometry(<extrusion referenced from the Rhino model>)
# Geometry Preparation
# Model + Grids
# Compute sDA
# Visualize Hourly
# Illuminance for
# a Sensor
# https://energyplus-weather.s3.amazonaws.com/north_and_central_america_wmo_region_4/USA/MA/USA_MA_Boston-Logan.Intl.AP.725090_TMY3/USA_MA_Boston-Logan.Intl.AP.725090_TMY3.zip
panel = Panel("ArchiTool V3.0")
list = ValueList({"Left": 0, "Center": 1, "Right": 2, "Stretch": 3}, selected="Stretch")
swatch = ColourSwatch(SwatchColor=RGB(237, 237, 237))
epw_link_list_israel = Panel("""https://climate.onebuilding.org/WMO_Region_6_Europe/ISR_Israel/Z_HaTsafon/ISR_Z_Mahanaim-Pina.AP.401761_TMYx.zip
https://climate.onebuilding.org/WMO_Region_6_Europe/ISR_Israel/Z_HaTsafon/ISR_Z_Zefat.Har.Kenaan.MS.401530_TMYx.2004-2018.zip
https://climate.onebuilding.org/WMO_Region_6_Europe/ISR_Israel/Z_HaTsafon/ISR_Z_Haifa.AP.401550_TMYx.zip
https://climate.onebuilding.org/WMO_Region_6_Europe/ISR_Israel/Z_HaTsafon/ISR_Z_Ramat.David.AB.401650_TMYx.zip
https://climate.onebuilding.org/WMO_Region_6_Europe/SYR_Syrian_Arab_Republic/SYR_QU_Sweida-UNDOF.400670_TMYx.zip
https://climate.onebuilding.org/WMO_Region_6_Europe/ISR_Israel/M_HaMerkaz/ISR_M_Netanya.401730_TMYx.zip
https://climate.onebuilding.org/WMO_Region_6_Europe/ISR_Israel/TA_Tel-Aviv/ISR_TA_Tel.Aviv-Sde.Dov.AP.401762_TMYx.zip
https://climate.onebuilding.org/WMO_Region_6_Europe/ISR_Israel/TA_Tel-Aviv/ISR_TA_Tel.Aviv-Bet.Dagan.401790_TMYx.zip
https://climate.onebuilding.org/WMO_Region_6_Europe/ISR_Israel/TA_Tel-Aviv/ISR_TA_Tel.Aviv-Ben.Gurion.Intl.AP.401800_TMYx.zip
https://climate.onebuilding.org/WMO_Region_6_Europe/ISR_Israel/JM_Yerushalayim/ISR_JM_Jerusalem.Center.401830_TMYx.2004-2018.zip
https://climate.onebuilding.org/WMO_Region_6_Europe/PSE_Palestine/PSE_WBK_Hebron.402400_TMYx.zip
https://climate.onebuilding.org/WMO_Region_6_Europe/PSE_Palestine/PSE_GZZ_Gaza.623380_TMYx.zip
https://climate.onebuilding.org/WMO_Region_6_Europe/PSE_Palestine/PSE_GZZ_Yasser.Arafat.Intl.AP-Gaza.Intl.AP.402300_TMYx.zip
https://climate.onebuilding.org/WMO_Region_6_Europe/ISR_Israel/D_HaDarom/ISR_D_Beer.Sheva-Teyman.AP.401910_TMYx.zip
https://climate.onebuilding.org/WMO_Region_6_Europe/ISR_Israel/D_HaDarom/ISR_D_Beer.Sheva.401900_TMYx.zip
https://climate.onebuilding.org/WMO_Region_6_Europe/ISR_Israel/D_HaDarom/ISR_D_Ovda.AP.401980_TMYx.zip
https://climate.onebuilding.org/WMO_Region_6_Europe/ISR_Israel/D_HaDarom/ISR_D_Eilat-Hozman.AP.401990_TMYx.zip""")
split = TextSplit(Text=epw_link_list_israel, Separators="/")
item = ListItem(List=reverse(split), Index=0, Wrap=True)
split_2 = TextSplit(Text=item, Separators="_")
item_2 = ListItem(List=split_2, Index=2, Wrap=True)  # -> flatten(Item)
panel_2 = Panel("""Low Res Grid [Faster] 5m
Mid Res Grid 1m
High Res Grid 0.5m
Ultra Res Grid [Slower] 0.3m
Hyper Res Grid [Slowest] 0.1m""")
dropdown_list = UiDropdownList(Values=panel_2, Index=2)
get_values = UiValues(Element=dropdown_list)
number_slider = Slider(0.5, range=0..1)  # disabled
number_slider_2 = Slider(8, range=0..23)  # disabled
number_slider_3 = Slider(1, range=0..10)  # disabled
panel_3 = Panel("""-------------------------------------------------------------------------------
Analysis period- Start to End""")
number_slider_4 = Slider(1, range=0..10)  # disabled
panel_4 = Panel("0")  # disabled
panel_5 = Panel("31")  # disabled
dom = ConstructDomain(DomainStart=panel_4, DomainEnd=panel_5)  # disabled
panel_6 = Panel("23")  # disabled
list_2 = ValueList({"Body": 0, "Bold": 1, "Title": 2, "Subtitle": 3, "Subtext": 4}, selected="Body")
panel_7 = Panel("Display Sky Matrix")  # disabled
check_box = UiCheckBox(Label=panel_7, State=False)  # disabled
merge = Merge(Data1=flatten(check_box))
roomsolid = HBRoomFromSolid(geo=flatten(geo), name="TestRoom", conditioned=True)  # -> report, rooms; plug-in component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
# Wea
# Visualize Daylight Autonomy
panel_8 = Panel("accurately models direct sun by tracing rays from each sensor to the solar position at each hour of the calculation. This makes the result suitable for computing Annual Sun Exposure (ASE)")
number_slider_5 = Slider(10, range=0..10)  # disabled
number_slider_6 = Slider(0.5, range=0..1)  # disabled
dom_2 = ConstructDomain(DomainStart=number_slider_6, DomainEnd=number_slider_5)  # disabled
toggle = BooleanToggle(True)  # disabled
number_slider_7 = Slider(1, range=1..12)  # disabled
toggle_2 = BooleanToggle(True)  # disabled
panel_9 = Panel("Start Month (1-12)")  # disabled
panel_10 = Panel("1")  # disabled
panel_11 = Panel("12")  # disabled
dom_3 = ConstructDomain(DomainStart=panel_10, DomainEnd=panel_11)  # disabled
panel_12 = Panel("End Hour (0-23)")  # disabled
number_slider_8 = Slider(8, range=0..23)  # disabled
panel_13 = Panel("End Day (1-31)")  # disabled
panel_14 = Panel("End Month (1-12)")  # disabled
panel_15 = Panel("1")  # disabled
panel_16 = Panel("12")  # disabled
dom_4 = ConstructDomain(DomainStart=panel_15, DomainEnd=panel_16)  # disabled
panel_17 = Panel("0")  # disabled
list_3 = ValueList({"Body": 0, "Bold": 1, "Title": 2, "Subtitle": 3, "Subtext": 4}, selected="Body")
panel_18 = Panel("""0
1
2""")
panel_19 = Panel("""0
1""")
panel_20 = Panel("""0
0""")
list_4 = ValueList({"Left": 0, "Center": 1, "Right": 2, "Stretch": 3}, selected="Stretch")
# Select GEO
legendpar = LBLegendParameters(num_decimals="0")  # -> leg_par; plug-in component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
applyfacemod = HBApplyFaceModifier()  # -> hb_objs; plug-in component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
merge_2 = Merge(Data1=flatten(panel_12), Data2=flatten(panel_13), Data3=flatten(panel_14))
dropdown_list_2 = UiDropdownList(Values=item_2, Index=7)
get_values_2 = UIValues(Element=dropdown_list_2)
item_3 = ListItem(List=epw_link_list_israel, Index=get_values_2, Wrap=True)
panel_21 = Panel(item_3)
text_block = UITextBlock(Text=panel_8)
get_values_3 = UiValues(Element=check_box)  # disabled
rh_sel_btn = UiRhinoSelectButton(Label="Geometry [Srf/Brep]", Filter=16)
get_values_4 = UIValues(Element=rh_sel_btn)
brep_3 = Brep(get_values_4)
brep_4 = Brep(brep_3)
debrep = DeconstructBrep(Brep=brep_4)  # -> Faces, Edges, Vertices
rh_sel_btn_2 = UiRhinoSelectButton(Label="Geometry [Srf/Brep]", Filter=16)
get_values_5 = UIValues(Element=rh_sel_btn_2)
brep_5 = Brep(get_values_5)
brep_6 = Brep(brep_5)
spacer_2 = UiSpacer(Width=10, Horizontal=False)
spacer_3 = UiSpacer(Width=10, Horizontal=False)
Y = UnitY(Factor=Slider(0, range=0..10))
label = UILabel(Label=merge_2, Style=list_3)
button = UiButton(Label="Visit Archidemy")
spacer_4 = UiSpacer(Width=10, Horizontal=False)
spacer_5 = UiSpacer(Width=10, Horizontal=False)
debrep_2 = DeconstructBrep(Brep=brep_6)  # -> Faces, Edges, Vertices
dom_5 = ConstructDomain(DomainStart=panel_17, DomainEnd=panel_6)  # disabled
brep_7 = Brep([<brep referenced from the Rhino model> x2])
beam = Brep([<brep referenced from the Rhino model> x7])
debrep_3 = DeconstructBrep(Brep=beam)  # -> Faces, Edges, Vertices
face = HBFace(geo=debrep_3.Faces)  # -> report, faces; plug-in component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
srf = Surface(<surface referenced from the Rhino model>)
sensorgrid = HBSensorGrid(base_geo=srf)  # -> grid; plug-in component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
srf_2 = Surface(<surface referenced from the Rhino model>)
wall = Brep([<brep referenced from the Rhino model> x4])
debrep_4 = DeconstructBrep(Brep=wall)  # -> Faces, Edges, Vertices
entwine = Entwine(Branch00=debrep_4.Faces, FlattenInputs=True)
face_2 = HBFace(geo=entwine)  # -> report, faces; plug-in component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
units_check = GhPythonScript()
# ---------- units_check: Python ----------
import rhinoscriptsyntax as rs
import Rhino
import scriptcontext as sc
from System.Windows.Forms import MessageBox

# Get the active Rhino document
doc = Rhino.RhinoDoc.ActiveDoc

# Check if the document is not using meters as the unit
if doc.ModelUnitSystem != Rhino.UnitSystem.Meters:
    # Display a popup message with additional instructions
    MessageBox.Show(
        "Warning: Rhino document units are not set to meters.\n\n"
        "Please close Rhino completely, reopen it, change the units to Meters, "
        "and only then open the Grasshopper file.",
        "Units Check"
    )
# ---------- end units_check ----------
rh_sel_btn_3 = UiRhinoSelectButton(Label="Geometry [Srf/Brep]", Filter=16)
get_values_6 = UIValues(Element=rh_sel_btn_3)
brep_8 = Brep(get_values_6)
brep_9 = Brep(brep_8)
debrep_5 = DeconstructBrep(Brep=brep_9)  # -> Faces, Edges, Vertices
rh_sel_btn_4 = UiRhinoSelectButton(Label="Context", Filter=16)
get_values_7 = UIValues(Element=rh_sel_btn_4)
brep_10 = Brep(get_values_7)
pt_2 = ConstructPoint(XCoordinate=Slider(75, range=0..200), YCoordinate=Slider(51, range=0..500), ZCoordinate=0)
panel_22 = Panel("""5
1
0.5
0.3
0.1""")
item_4 = ListItem(List=panel_22, Index=get_values, Wrap=True)
panel_23 = Panel(item_4)
panel_24 = Panel("Sun Scale")  # disabled
dom_6 = ConstructDomain(DomainStart="0", DomainEnd="360")
panel_25 = Panel("""0
1
2""")
panel_26 = Panel("""0
0
0""")
number_slider_9 = Slider(8, range=0..23)  # disabled
# Run
scroll_integer = UIScrollInteger(Integer=number_slider_9, Wrap=toggle, Increment=number_slider_4, Bounds=dom)  # disabled
get_values_8 = UiValues(Element=scroll_integer)  # disabled
panel_27 = Panel("Start Day (1-31)")  # disabled
panel_28 = Panel(get_values_8)  # disabled
panel_29 = Panel("23")  # disabled
number_slider_10 = Slider(8, range=0..23)  # disabled
toggle_3 = BooleanToggle(True)  # disabled
number_slider_11 = Slider(1, range=0..10)  # disabled
number_slider_12 = Slider(1, range=1..12)  # disabled
toggle_4 = BooleanToggle(True)  # disabled
number_slider_13 = Slider(1, range=0..10)  # disabled
scroll_integer_2 = UIScrollInteger(Integer=number_slider_12, Wrap=toggle_4, Increment=number_slider_13, Bounds=dom_4)  # disabled
get_values_9 = UiValues(Element=scroll_integer_2)  # disabled
panel_30 = Panel(merge_2)
panel_31 = Panel("""0
0
0""")
button_2 = UiButton(Label="Run")
get_values_10 = UiValues(Element=button_2)
card = UiCardLayout(Elements=button_2, Title="Run")
bool = Boolean(get_values_10)
reset_button = Python3Script(x=bool)  # -> out, a
# ---------- reset_button: Python ----------
import Grasshopper as gh

# Make 'previous' persist across script executions
global previous
try:
    previous
except NameError:
    previous = False

# Default output
pulse = False

# Detect a rising edge: (x == True) AND (previous == False)
if x and not previous:
    pulse = True
    # Schedule an immediate re-calculation to reset output
    doc = ghenv.Component.OnPingDocument()
    if doc:
        doc.ScheduleSolution(1, lambda d: ghenv.Component.ExpireSolution(False))

# Store the current state for next run
previous = x

# Output the one-shot pulse
a = pulse
# ---------- end reset_button ----------
panel_32 = Panel(reset_button.a)
record = RecordData(Data=reset_button.a, Record=True, Reset=False, RecordFirstDataOnReset=True)
panel_33 = Panel(record)
text_block_2 = UITextBlock(Text="Annual Daylight")
rh_sel_btn_5 = UiRhinoSelectButton(Label="Room [Aperture]", Filter=16)
get_values_11 = UIValues(Element=rh_sel_btn_5)
brep_11 = Brep(get_values_11)
panel_34 = Panel(face_2.report)
panel_35 = Panel("""0
1""")
panel_36 = Panel("""0
0""")
panel_37 = Panel("""[
  {
    "name": "Concrete",
    "type": "HB_RadianceOpaqueModifier",
    "diffuse_reflectance": 0.3,
    "specular_reflectance": 0.02,
    "roughness": 0.1
  },
  {
    "name": "Dark_Wood",
    "type": "HB_RadianceOpaqueModifier",
    "diffuse_reflectance": 0.25,
    "specular_reflectance": 0.05,
    "roughness": 0.3
  }
]""")
json_tree = Python3Script(json_in=panel_37)  # -> out, keys, tree, columns; inputs json_in: String
# ---------- json_tree: Python ----------
"""
Inputs  : json_in  (str) – either a file path OR the full JSON text
Outputs : tree     (DataTree[str]) – row-aligned data tree
          keys     (list[str])      – ordered list of column headers
          columns  (dict)           – column-wise lookup for later use
"""
import json, os
from Grasshopper import DataTree
from Grasshopper.Kernel.Data import GH_Path

# ---------- helper -----------------------------------------------------------
def load_json(src):
    """Return a Python list loaded from a filepath OR from raw JSON text."""
    src = src.strip()
    # Heuristic: looks like JSON text if it starts with { or [
    if src.startswith("{") or src.startswith("["):
        return json.loads(src)
    # Otherwise assume it is a path on disk
    if not os.path.isfile(src):
        raise ValueError("Input is neither JSON text nor a valid file-path.")
    with open(src, "r") as f:
        return json.load(f)

# ---------- main -------------------------------------------------------------
tree   = DataTree[str]()
keys   = []
columns = {}

if not json_in:
    raise ValueError("Connect JSON (text or path) to the 'json_in' input.")

data = load_json(json_in)

if not isinstance(data, list):
    raise ValueError("Top-level JSON should be a list of objects.")

# 1. fixed columns first
fixed = ["name", "type"]
dynamic = set()
for obj in data:
    if not isinstance(obj, dict):
        raise ValueError("Every item in the array must be a JSON object.")
    dynamic.update(k for k in obj.keys() if k not in fixed)

keys = fixed + sorted(dynamic)

# 2. initialise column dictionary
for k in keys:
    columns[k] = []

# 3. build the data tree + fill columns
for i, obj in enumerate(data):
    path = GH_Path(i)
    for k in keys:
        val = obj.get(k, "")   # empty string if key missing
        s   = str(val)
        tree.Add(s, path)
        columns[k].append(s)
# ---------- end json_tree ----------
item_5 = ListItem(List=json_tree.tree, Index=0, Wrap=True)  # -> Item, Item1, Item2, Item3, Item4
item_6 = ListItem(List=json_tree.tree, Index=0, Wrap=True)  # -> flatten(Item)
spec = Data(item_5.Item4)
rough = Data(item_5.Item3)
panel_38 = Panel(json_tree.keys)
item_7 = ListItem(List=json_tree.tree, Index=0, Wrap=True)  # -> flatten(Item)
panel_39 = Panel(item_7)
dropdown_list_3 = UiDropdownList(Values=panel_39, Index=0)
get_values_12 = UiValues(Element=dropdown_list_3)
item_8 = ListItem(List=flatten(spec), Index=get_values_12, Wrap=True)
item_9 = ListItem(List=flatten(item_5.Item), Index=get_values_12, Wrap=True)
item_10 = ListItem(List=flatten(rough), Index=get_values_12, Wrap=True)
dropdown_list_4 = UiDropdownList(Values=panel_39, Index=0)
get_values_13 = UiValues(Element=dropdown_list_4)
item_11 = ListItem(List=flatten(item_5.Item), Index=get_values_13, Wrap=True)
item_12 = ListItem(List=flatten(rough), Index=get_values_13, Wrap=True)
item_13 = ListItem(List=flatten(spec), Index=get_values_13, Wrap=True)
dropdown_list_5 = UiDropdownList(Values=panel_39, Index=0)
get_values_14 = UiValues(Element=dropdown_list_5)
item_14 = ListItem(List=flatten(spec), Index=get_values_14, Wrap=True)
item_15 = ListItem(List=flatten(rough), Index=get_values_14, Wrap=True)
item_16 = ListItem(List=flatten(item_5.Item), Index=get_values_14, Wrap=True)
rad = Panel(item_16)
reflect = Data(item_5.Item2)
item_17 = ListItem(List=flatten(reflect), Index=get_values_13, Wrap=True)
item_18 = ListItem(List=flatten(reflect), Index=get_values_12, Wrap=True)
opaquemod = HBOpaqueModifier(name=item_11, reflect=item_17, spec=item_13, rough=item_12)  # -> modifier; plug-in component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
opaquemod_2 = HBOpaqueModifier(name=item_9, reflect=item_18, spec=item_8, rough=item_10)  # -> modifier; plug-in component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
item_19 = ListItem(List=flatten(reflect), Index=get_values_14, Wrap=True)
opaquemod_3 = HBOpaqueModifier(name=item_16, reflect=item_19, spec=item_14, rough=item_15)  # -> modifier; plug-in component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
entwine_2 = Entwine(Branch00=opaquemod, Branch01=opaquemod_3, Branch02=opaquemod_2, FlattenInputs=True)
clean = CleanTree(RemoveNulls=True, RemoveInvalid=True, RemoveEmpty=True, Tree=entwine_2)
panel_40 = Panel(json_tree.tree)
panel_41 = Panel(get_values_10)
rad_2 = Panel(item_9)
rh_sel_btn_6 = UiRhinoSelectButton(Label="Geometry [Srf/Brep]", Filter=16)
get_values_15 = UIValues(Element=rh_sel_btn_6)
brep_12 = Brep(get_values_15)
brep_13 = Brep(brep_12)
debrep_6 = DeconstructBrep(Brep=brep_13)  # -> Faces, Edges, Vertices
entwine_3 = Entwine(Branch00=debrep_6.Faces, Branch01=debrep_2.Faces, FlattenInputs=True)
clean_2 = CleanTree(RemoveNulls=True, RemoveInvalid=True, RemoveEmpty=True, Tree=entwine_3)
panel_42 = Panel("""[
  { "name": "Glass_Clear", "trans": 0.85, "refract": 1.52 },
  { "name": "Glass_LowE", "trans": 0.60, "refract": 1.52 },
  { "name": "Glass_Tinted", "trans": 0.30, "refract": 1.52 },
  { "name": "Glass_SolarControl", "trans": 0.20, "refract": 1.52 }
]""")
json_tree_2 = Python3Script(json_in=panel_42)  # -> out, keys, tree, columns; inputs json_in: String; same code as json_tree
item_20 = ListItem(List=json_tree_2.tree, Index=0, Wrap=True)  # -> Item, Item1, Item2, Item3, Item4, Item5, Item6, Item7, Item8
reflect_2 = Data(item_20.Item2)
panel_43 = Panel(json_tree_2.tree)
panel_44 = Panel(json_tree_2.keys)
transmission = Data(item_20.Item3)
item_21 = ListItem(List=json_tree_2.tree, Index=0, Wrap=True)  # -> flatten(Item)
item_22 = ListItem(List=json_tree_2.tree, Index=0, Wrap=True)  # -> flatten(Item)
panel_45 = Panel(item_22)
dropdown_list_6 = UiDropdownList(Values=panel_45, Index=0)
get_values_16 = UiValues(Element=dropdown_list_6)
item_23 = ListItem(List=flatten(item_20.Item), Index=get_values_16, Wrap=True)
item_24 = ListItem(List=flatten(transmission), Index=get_values_16, Wrap=True)
item_25 = ListItem(List=flatten(reflect_2), Index=get_values_16, Wrap=True)
glassmod = HBGlassModifier(name=item_23, trans=item_24, refract=item_25)  # -> modifier; plug-in component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
dropdown_list_7 = UiDropdownList(Values=panel_45, Index=0)
merge_3 = Merge(
    Data1=flatten(dropdown_list_7),
    Data2=flatten(rh_sel_btn_6),
    Data3=flatten(spacer_5),
    Data4=flatten(dropdown_list_6),
    Data5=flatten(rh_sel_btn_2),
    Data6=flatten(spacer))
card_2 = UiCardLayout(Elements=merge_3, Title="Glass Geometry")
get_values_17 = UiValues(Element=dropdown_list_7)
item_26 = ListItem(List=flatten(transmission), Index=get_values_17, Wrap=True)
item_27 = ListItem(List=flatten(reflect_2), Index=get_values_17, Wrap=True)
item_28 = ListItem(List=flatten(item_20.Item), Index=get_values_17, Wrap=True)
glassmod_2 = HBGlassModifier(name=item_28, trans=item_26, refract=item_27)  # -> modifier; plug-in component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
entwine_4 = Entwine(Branch00=glassmod_2, Branch01=glassmod, FlattenInputs=True)
clean_3 = CleanTree(RemoveNulls=True, RemoveInvalid=True, RemoveEmpty=True, Tree=entwine_4)
# Run Recipe
swatch_2 = ColourSwatch(SwatchColor=RGB(0, 0, 0))
swatch_3 = ColourSwatch(SwatchColor=RGB(237, 237, 237))
number_slider_14 = Slider(1, range=0.1..20)  # disabled
slider = UISlider(Label=panel_24, Value=number_slider_14, Bounds=dom_2, Increment=number_slider)  # disabled
get_values_18 = UiValues(Element=slider)  # disabled
slider_2 = UISlider(Label="North", Value=Slider(0, range=0..360), Bounds=dom_6, Increment=Slider(1, range=0..1))
merge_4 = Merge(Data1=flatten(dropdown_list_2), Data2=flatten(slider_2), Data3=flatten(dropdown_list))
get_values_19 = UiValues(Element=slider_2)
resize = UiResize(Element=[dropdown_list_2, rh_sel_btn_3, rh_sel_btn_4, dropdown_list, slider, slider_2, button_2], Alignment=list)
card_3 = UiCardLayout(Elements=merge_4, Title="Analysis Settings")
toggle_5 = BooleanToggle(True)  # disabled
panel_46 = Panel("Start Hour(0-23)")  # disabled
merge_5 = Merge(Data1=flatten(panel_46), Data2=flatten(panel_27), Data3=flatten(panel_9))
label_2 = UILabel(Label=merge_5, Style=list_2)
grid = UiGridLayout(Elements=label_2, Columns=panel_25, Rows=panel_26)
panel_47 = Panel(merge_5)
list_5 = ValueList({"Body": 0, "Bold": 1, "Title": 2, "Subtitle": 3, "Subtext": 4}, selected="Body")
label_3 = UILabel(Label=panel_3, Style=list_5)
number_slider_15 = Slider(1, range=0..10)  # disabled
scroll_integer_3 = UIScrollInteger(Integer=number_slider_7, Wrap=toggle_2, Increment=number_slider_15, Bounds=dom_3)  # disabled
get_values_20 = UiValues(Element=scroll_integer_3)  # disabled
panel_48 = Panel(get_values_20)  # disabled
panel_49 = Panel("0")  # disabled
dom_7 = ConstructDomain(DomainStart=panel_49, DomainEnd=panel_29)  # disabled
scroll_integer_4 = UIScrollInteger(Integer=number_slider_2, Wrap=toggle_5, Increment=number_slider_3, Bounds=dom_7)  # disabled
merge_6 = Merge(Data1=flatten(scroll_integer_4), Data2=flatten(scroll_integer), Data3=flatten(scroll_integer_3))
get_values_21 = UiValues(Element=scroll_integer_4)  # disabled
grid_2 = UiGridLayout(Elements=merge_6, Columns=panel_25, Rows=panel_26)
panel_50 = Panel(get_values_21)  # disabled
toggle_6 = BooleanToggle(True)  # disabled
number_slider_16 = Slider(1, range=0..10)  # disabled
scroll_integer_5 = UIScrollInteger(Integer=number_slider_10, Wrap=toggle_6, Increment=number_slider_16, Bounds=dom_5)  # disabled
get_values_22 = UiValues(Element=scroll_integer_5)  # disabled
panel_51 = Panel(get_values_22)  # disabled
panel_52 = Panel(get_values_9)  # disabled
panel_53 = Panel("0")  # disabled
panel_54 = Panel("31")  # disabled
dom_8 = ConstructDomain(DomainStart=panel_53, DomainEnd=panel_54)  # disabled
scroll_integer_6 = UIScrollInteger(Integer=number_slider_8, Wrap=toggle_3, Increment=number_slider_11, Bounds=dom_8)  # disabled
merge_7 = Merge(Data1=flatten(scroll_integer_5), Data2=flatten(scroll_integer_6), Data3=flatten(scroll_integer_2))
get_values_23 = UiValues(Element=scroll_integer_6)  # disabled
panel_55 = Panel(get_values_23)  # disabled
panel_56 = Panel("""0
0
0""")
grid_3 = UiGridLayout(Elements=merge_7, Columns=panel_18, Rows=panel_56)
panel_57 = Panel("""0
1
2""")
grid_4 = UiGridLayout(Elements=label, Columns=panel_57, Rows=panel_31)
merge_8 = Merge(
    Data2=flatten(dropdown_list),
    Data3=flatten(slider),
    Data4=flatten(slider_2),
    Data5=flatten(label_3),
    Data6=flatten(grid),
    Data7=flatten(grid_2),
    Data8=flatten(grid_4),
    Data9=flatten(grid_3))
font = UiSetFont(Element=[text_block_2, button_2], Family="Rajdhani", Size=20, Bold=True)
panel_58 = Panel(reset_button.a)
bool_2 = Boolean(panel_58)
card_4 = UiCardLayout(Elements=merge, Title="Display")
glassmod_3 = HBGlassModifier(name="g_material", trans="0.55")  # -> modifier; plug-in component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
aperture = HBAperture(geo=brep, rad_mod=glassmod_3)  # -> report, apertures; plug-in component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
addsubface = HBAddSubface(hb_obj=flatten(roomsolid.rooms), sub_faces=flatten(aperture.apertures))  # -> hb_obj; plug-in component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
bordershades = HBExtrudedBorderShades(hb_objs=flatten(addsubface), depth="0.3")  # -> report, hb_objs; plug-in component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
panel_59 = Panel("0.5")
gridrooms = HBSensorGridFromRooms(rooms=bordershades.hb_objs, grid_size=Slider(3, range=0..10))  # -> grid, points, mesh; plug-in component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
glassmod_4 = HBGlassModifier(name="g_material", trans="0.55")  # -> modifier; plug-in component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
aperture_2 = HBAperture(geo=brep_2, rad_mod=glassmod_4)  # -> report, apertures; plug-in component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
face_3 = HBFace(geo=srf_2, name="Floor", type="Floor")  # -> report, faces; plug-in component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
opaquemod_4 = HBOpaqueModifier(name="wood", reflect="0.45", spec="0.05", rough="0.1")  # -> modifier; plug-in component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
decnstrmod = HBDeconstructModifier(mod=opaquemod_4)  # -> rad_str; plug-in component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
panel_60 = Panel(decnstrmod)
panel_61 = Panel(opaquemod_4)
data = Data(panel_61)
applyfacemod_2 = HBApplyFaceModifier(hb_objs=flatten(face.faces), mod=data)  # -> hb_objs; plug-in component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
model = HBModel(faces=flatten([face_2.faces, applyfacemod_2]))  # -> report, model; plug-in component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
button_3 = UiButton(Label="Contact Us")
merge_9 = Merge(Data1=flatten(button), Data2=flatten(button_3))
grid_5 = UiGridLayout(Elements=merge_9, Columns=panel_35, Rows=panel_36)
rad_3 = Panel(item_11)
rh_sel_btn_7 = UiRhinoSelectButton(Label="Geometry [Srf/Brep]", Filter=16)
merge_10 = Merge(
    Data1=flatten(dropdown_list_4),
    Data2=flatten(rh_sel_btn_3),
    Data3=flatten(spacer_3),
    Data4=flatten(dropdown_list_5),
    Data5=flatten(rh_sel_btn_7),
    Data6=flatten(spacer_4),
    Data7=flatten(dropdown_list_3),
    Data8=flatten(rh_sel_btn))
resize_2 = UiResize(Element=[rh_sel_btn_3, dropdown_list_4, merge_10, merge_3], Alignment=list_4)
get_values_24 = UIValues(Element=rh_sel_btn_7)
card_5 = UiCardLayout(Elements=merge_10, Title="Solid Geometry")
merge_11 = Merge(
    Data1=flatten(card_5),
    Data2=flatten(card_2),
    Data3=flatten(spacer_2),
    Data4=flatten(card_3),
    Data5=flatten(spacer_2),
    Data6=flatten(card_4),
    Data7=flatten(card))
merge_12 = Merge(Data1=flatten(merge_11))
lng = ListLength(List=merge_11)
dup = DuplicateData(Data="Design Performance", Number=lng, Order=True)
merge_13 = Merge(Data1=flatten(card_5), Data2=flatten(card_2), Data3=flatten(card), Data4=flatten(card_3), Data5=flatten(card_4))
graphics = UiSetGraphics(
    Element=merge_13,
    PrimaryColor=swatch_2,
    AccentColor=ColourSwatch(SwatchColor=RGB(255, 255, 255)),
    StrokeColor=swatch,
    StrokeWeight=0)
graphics_2 = UiSetGraphics(
    Element=[dropdown_list_4, merge_10, merge_3],
    PrimaryColor=ColourSwatch(SwatchColor=RGB(94, 94, 94)),
    AccentColor=swatch,
    StrokeColor=swatch,
    StrokeWeight=0)
grid_6 = UiGridLayout(Elements=merge_10, Columns=panel_19, Rows=panel_20)
tab = UiTabbedLayout(Elements=merge_12, Names=dup)
brep_14 = Brep(get_values_24)
brep_15 = Brep(brep_14)
debrep_7 = DeconstructBrep(Brep=brep_15)  # -> Faces, Edges, Vertices
entwine_5 = Entwine(Branch00=debrep_5.Faces, Branch01=debrep_7.Faces, Branch02=debrep.Faces, FlattenInputs=True)
clean_4 = CleanTree(RemoveNulls=True, RemoveInvalid=True, RemoveEmpty=True, Tree=entwine_5)

dam = DataDam(DataBrepOpaque=clean_4, BufferDelay=10000000, BufferMode=0)
dam_2 = DataDam(DataRadOpaque=clean, BufferDelay=10000000, BufferMode=0)
dam_3 = DataDam(DataBrepGlass=clean_2, BufferDelay=10000000, BufferMode=0)
dam_4 = DataDam(DataResGrid=item_4, BufferDelay=10000000, BufferMode=0)
dam_5 = DataDam(DataSunScale=get_values_18, BufferDelay=10000000, BufferMode=0)
dam_6 = DataDam(DataRadGlass=clean_3, BufferDelay=10000000, BufferMode=0)
dam_7 = DataDam(DataNorth=get_values_19, BufferDelay=10000000, BufferMode=0)
dam_8 = DataDam(DataRoom=brep_11, BufferDelay=10000000, BufferMode=0)
objfromgroup = GetObjectsInGroup()
dam_9 = DataDam(DataEPW=item_3, BufferDelay=10000000, BufferMode=0)

shade = HBShade(geo=dam)  # -> report, shades; disabled; plug-in component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
model_2 = HBModel(rooms=flatten(bordershades.hb_objs), shades=flatten(shade.shades), name="sample_model_grid")  # -> report, model; plug-in component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
gridfaces = HBSensorGridFromFaces(hb_objs=face_3.faces, grid_size=dam_4, face_type=Slider(3, range=0..10))  # -> grid, points, mesh; plug-in component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
assigngridsviews = HBAssignGridsAndViews(model=model_2.model, grids=flatten(gridrooms.grid))  # -> model; plug-in component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
mjoin = MeshJoin(Meshes=gridfaces.mesh)
bbox = BoundingBox(Content=mjoin, Plane=PlaneXY(0, 0, 0))  # -> Box, Box_2
debrep_8 = DeconstructBrep(Brep=bbox.Box)  # -> Faces, Edges, Vertices
pdecon = Deconstruct(Point=debrep_8.Vertices)  # -> XComponent, YComponent, ZComponent
sort = SortList(Keys=pdecon.ZComponent, ValuesA=debrep_8.Vertices)  # -> Keys, ValuesA
panel_62 = Panel(dam_6)
panel_63 = Panel(dam_2)
downloadepw = LBDownloadWeather(weather_URL=dam_9)  # -> epw_file, stat_file, ddy_file; plug-in component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
wea = HBWeaFromEPW(epw_file=downloadepw.epw_file)  # -> wea; plug-in component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
vizwiref = HBVisualizeWireframe(hb_objs=flatten(model_2.model))  # -> geo; plug-in component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
assigngridsviews_2 = HBAssignGridsAndViews(model=model.model, grids=flatten(gridfaces.grid))  # -> model; plug-in component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
face_4 = HBFace(geo=dam)  # -> report, faces; plug-in component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
applyfacemod_3 = HBApplyFaceModifier(hb_objs=flatten(face_4.faces), mod=dam_2)  # -> hb_objs; plug-in component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
panel_64 = Panel(face_4.faces)
face_5 = HBFace(geo=dam_3)  # -> report, faces; plug-in component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
applyfacemod_4 = HBApplyFaceModifier(hb_objs=flatten(face_5.faces), mod=dam_6)  # -> hb_objs; plug-in component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
model_3 = HBModel(faces=flatten([applyfacemod_3, applyfacemod_4]))  # -> report, model; plug-in component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
assigngridsviews_3 = HBAssignGridsAndViews(model=model_3.model, grids=flatten(gridfaces.grid))  # -> model; plug-in component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
annualdaylight = HBAnnualDaylight(model=assigngridsviews_3, wea=wea, north=dam_7, enhanced=Toggle(True), run=Toggle(True))  # -> report, results, DA, cDA, UDI, UDI_low, UDI_up; plug-in component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
sda = HBSpatialDaylightAutonomy(DA=annualdaylight.DA)  # -> report, sDA, pass_fail; plug-in component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
sda_in_each_room = Panel(sda.sDA)
# Settings
importepw = LBImportEPW(epw_file=downloadepw.epw_file)  # -> location, dry_bulb_temperature, dew_point_temperature, relative_humidity, wind_speed, wind_direction, direct_normal_rad, diffuse_horizontal_rad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; plug-in component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
# Select GEO
sunpath = LBSunPath(north=dam_7, location=importepw.location, scale=1)  # -> report, vectors, altitudes, azimuths, hoys, sun_pts, analemma, daily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; plug-in component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
item_29 = ListItem(List=flatten(dam), Index=0, Wrap=True)
# Opaque materials
# Glass materials
authorization_v3_0_3_limit_vercel = Python3Script(toggle=item_29)  # -> out, a
# ---------- authorization_v3_0_3_limit_vercel: Python ----------
import clr 
import Rhino
import json

clr.AddReference("System")
from System.Net import WebClient, WebException, WebExceptionStatus, HttpWebResponse

# Node.js server URL
AUTH_URL = "https://architool-v3-server.vercel.app/authorize"

def check_authorization(serial_number):
    """
    Checks authorization by querying the Node.js server with the given serial number.
    
    Parameters:
        serial_number (str): The Rhino serial number.

    Returns:
        tuple: (authorized (bool), message (str), return_value (int))
               When authorized, return_value is the remaining daily uses.
               When an error occurs, return_value is an error code:
                   20 = Internet connection error
                   30 = Server connection error
                   40 = JSON parsing error
                   50 = Unexpected error
                   60 = Unauthorized access error
    """
    try:
        # Build the full URL with query parameter
        url = "{}?serialNumber={}".format(AUTH_URL, serial_number)
        wc = WebClient()
        response_data = wc.DownloadString(url)
        
        # Parse the JSON response
        data = json.loads(response_data)
        authorized = data.get('authorized', False)
        message = data.get('message', "No message").strip()
        remaining_uses = data.get('remainingUses', 0)
        
        return authorized, message, remaining_uses
    
    except WebException as web_ex:
        # If the exception has a response, we try to inspect it for status code details
        if web_ex.Response is not None:
            http_response = web_ex.Response
            # Ensure we have an HttpWebResponse to extract status code information
            if isinstance(http_response, HttpWebResponse):
                status_code = int(http_response.StatusCode)
                if status_code in (401, 403):
                    return False, "Error: Unauthorized access.", 60
        # Differentiate between internet connection issues and server issues
        if web_ex.Status in (WebExceptionStatus.ConnectFailure, 
                             WebExceptionStatus.NameResolutionFailure, 
                             WebExceptionStatus.ProxyNameResolutionFailure):
            return False, "Error: Internet connection problem. Please check your network connection.", 20
        else:
            return False, "Error: Problem connecting to the server.", 30

    except ValueError as json_err:
        return False, "Error: JSON parsing error: " + str(json_err), 40
    except Exception as e:
        return False, "Error: Unexpected error: " + str(e), 50

def process_authorization(toggle):
    """
    Processes the authorization check based on the toggle value.

    Parameters:
        toggle (bool): If True, perform the authorization check; if False, skip it.
    """
    if not toggle:
        print("Toggle is set to False. Skipping authorization check.")
        print("0")
        return

    # Get the Rhino serial number; check if valid
    serial_number = Rhino.RhinoApp.SerialNumber
    if not serial_number:
        print("Error: Could not retrieve the Rhino serial number. Please ensure Rhino is properly licensed.")
        print("10")
        return

    authorized, message, code = check_authorization(serial_number)

    # Handle the response based on the return code
    if authorized:
        print("Active Educational License")
        print("Remaining Daily Uses: {}".format(code))
        print("1")
    elif "daily usage limit reached" in message.lower():
        print("Error: Daily limit for your educational license has been reached.")
        print("Please contact support at info@01Architecture.com for assistance.")
        print("3")
    else:
        # For error cases, print the error message and its corresponding error code
        print(message)
        print(code)

if __name__ == "__main__":
    toggle = True  # Change this based on your Grasshopper input
    process_authorization(toggle)
    print("01A_ArchiTools V3.0.3")
# ---------- end authorization_v3_0_3_limit_vercel ----------
item_30 = ListItem(List=authorization_v3_0_3_limit_vercel.out, Index=0, Wrap=True)  # -> Item2, Item1, Item
panel_65 = Panel(authorization_v3_0_3_limit_vercel.out)
data_2 = Data(flatten(annualdaylight.DA))
heatmap = LBSpatialHeatmap(values=data_2, mesh=mjoin, legend_title="%")  # -> mesh, legend, title, colors, legend_par, vis_set; plug-in component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
text_block_3 = UITextBlock(Text=item_30.Item)  # disabled
merge_14 = Merge(Data1=flatten(text_block_2), Data2=flatten(text_block), Data3=flatten(text_block_3), Data4=flatten(tab))
font_2 = UiSetFont(Element=merge_14, Family="Rajdhani")
item_31 = ListItem(List=sort.ValuesA, Index=[0, 1, 2, 3], Wrap=True)
pdecon_2 = Deconstruct(Point=item_31)  # -> XComponent, YComponent, ZComponent
sort_2 = SortList(Keys=pdecon_2.XComponent, ValuesA=item_31)  # -> Keys, ValuesA
lng_2 = ListLength(List=objfromgroup)
autorized = Data(item_30.Item2)
filter = StreamFilter(Gate=autorized, Stream1=bool_2)
dup_2 = DuplicateData(Data=filter, Number=lng_2, Order=True)
setobj = SetObjectValue(ObjectToSet=objfromgroup, ValueToSet=dup_2)
window = UIWindow(Elements=merge_14, Title=panel, Owner=2, Scroll=True, Launch=Toggle(True))
modify_win = UiModifyWindow(Window=window, Position=pt_2, HideControls=True, HideTitle=True)
item_32 = ListItem(List=authorization_v3_0_3_limit_vercel.out, Index=0, Wrap=True)  # -> Item2, Item1, Item, Item1_2
panel_66 = Panel(item_32.Item1_2)
autorized_2 = Data(item_32.Item2)
item_33 = ListItem(List=sort_2.ValuesA, Index=0, Wrap=True)
move = Move(Geometry=item_33, Motion=Y)  # -> Geometry, Transform
filter_2 = StreamFilter(Gate=autorized, Stream1=dam_8)
equals = Equality(FirstNumber=autorized_2, SecondNumber=1)  # -> Equality, Inequality
filter_3 = StreamFilter(Gate=equals.Equality, Stream0=item_32.Item2)
concat = Concatenate(FragmentA=item_32.Item, FragmentC=" ", FragmentB=filter_3)
panel_67 = Panel(concat)
multiplication = Multiplication(A=sda.sDA, B=100)
opening = Data(dam_2)
int = Integer(multiplication)
concat_2 = Concatenate(FragmentC="sDA", FragmentD=" ", FragmentA=int, FragmentB="%")
null = NullItem(Item=sda.sDA)  # -> NullFlags, InvalidFlags, Description
filter_4 = StreamFilter(Gate=null.InvalidFlags, Stream0=concat_2)
tag = TextTag(Location=move.Geometry, Text=filter_4)
pt_3 = Point(gridfaces.points)
bang = ExplodeTree(Data=pt_3)  # -> Branch0, Branch1
item_34 = ListItem(List=bang.Branch0, Index="60", Wrap=True)
sph = Sphere(Base=item_34, Radius="0.5")
data_3 = Data(annualdaylight.results)
annualtodata = HBAnnualResultsToData(results=flatten(data_3), sel_pts=flatten(item_34), all_pts=pt_3)  # -> report, data; plug-in component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
hourlyplot = LBHourlyPlot(data=annualtodata.data, base_pt="50,0,0", legend_par=legendpar)  # -> report, mesh, legend, borders, labels, title, vis_set; plug-in component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
panel_68 = Panel(annualdaylight.DA)
panel_69 = Panel(face_5.faces)
panel_70 = Panel(merge_11)
log = Result([concat, item_32.Item1_2])
