# Grasshopper definition 2fb7f924.gh (Grasshopper 1.0.8)
# plug-ins: RhinoCodePluginGH, UiPlus

list = ValueList({"Left": 0, "Center": 1, "Right": 2, "Stretch": 3}, selected="Stretch")
panel = Panel("01A_ShadowAnalysis")
# Error: No Active Educational License Detected
# 
# It appears that no active Educational License is available for 01A_ArchiTools. Please contact support at info@01Architecture.com for assistance.
# 
# Yaniv Hatiel
panel_2 = Panel("Visit Archidemy")
panel_3 = Panel("""0
1""")
# Basic
text_block = UITextBlock(Text="ArchiTool V3.0")
name = Data(simplify(Tree({0}: ["TerrainGenerator"], {2}: ["ShadowAnalysis2"])))
command = Data(simplify(Tree({0}: ["01A_TerrainGenerator"], {2}: ["01A_ShadowAnalysis2"])))
rh_cmd_btn = UiRhinoCommandButton(Label=name, Commands=command)
tab = Data(simplify(Tree({0}: ["SiteModeling"], {2}: ["SitaAnalysis"])))
font = UiSetFont(Element=text_block, Family="Rajdhani", Size=20, Bold=True)
get_values = UIValues(Element=rh_cmd_btn)
panel_4 = Panel("https://drive.google.com/uc?export=download&id=113buBmasWc5Z_t1SCX8mZzsfimKm95cO")
py3 = Python3Script(url=panel_4)  # -> out, a; disabled
# ---------- py3: Python ----------
import clr
import os
import tempfile
import time
import Rhino
import System.Drawing  # For PointF
import ctypes
import ctypes.wintypes

# Ensure that the input 'url' is provided.
if url is None or url.strip() == "":
    result = "Update and load ArchiTool failed: No URL provided."
else:
    # --------------------------
    # Download GH file.
    # --------------------------
    def download_gh_file():
        from System.Net import WebClient
        wc = WebClient()
        temp_file = os.path.join(tempfile.gettempdir(), "model_set.gh")
        try:
            wc.DownloadFile(url, temp_file)
            if not os.path.exists(temp_file):
                return None
        except Exception:
            return None
        return temp_file

    # --------------------------
    # Window enumeration/manipulation.
    # --------------------------
    def enum_windows_callback(hwnd, lParam):
        if ctypes.windll.user32.IsWindowVisible(hwnd):
            length = ctypes.windll.user32.GetWindowTextLengthW(hwnd)
            buffer = ctypes.create_unicode_buffer(length + 1)
            ctypes.windll.user32.GetWindowTextW(hwnd, buffer, length + 1)
            if "Grasshopper" in buffer.value:
                windows_list = ctypes.cast(lParam, ctypes.POINTER(ctypes.py_object)).contents.value
                windows_list.append(hwnd)
        return True

    def find_grasshopper_window():
        windows = []
        pointer = ctypes.pointer(ctypes.py_object(windows))
        EnumWindowsProc = ctypes.WINFUNCTYPE(ctypes.c_bool, ctypes.wintypes.HWND, ctypes.wintypes.LPARAM)
        # Fix: Cast pointer to c_void_p instead of wintypes.LPARAM.
        ctypes.windll.user32.EnumWindows(EnumWindowsProc(enum_windows_callback), ctypes.cast(pointer, ctypes.c_void_p))
        return windows[0] if windows else None

    def open_grasshopper_invisibly():
        Rhino.RhinoApp.RunScript("Grasshopper", False)
        start = time.time()
        hwnd = None
        while time.time() - start < 5:
            hwnd = find_grasshopper_window()
            if hwnd:
                ctypes.windll.user32.ShowWindow(hwnd, 0)  # SW_HIDE
                break
            time.sleep(0.05)
        return hwnd

    def minimize_grasshopper_window():
        SW_MINIMIZE = 6
        hwnd = find_grasshopper_window()
        if hwnd:
            ctypes.windll.user32.ShowWindow(hwnd, SW_MINIMIZE)

    def hide_grasshopper_window_completely():
        GWL_STYLE = -16
        WS_VISIBLE = 0x10000000
        hwnd = find_grasshopper_window()
        if hwnd:
            current_style = ctypes.windll.user32.GetWindowLongW(hwnd, GWL_STYLE)
            new_style = current_style & ~WS_VISIBLE
            ctypes.windll.user32.SetWindowLongW(hwnd, GWL_STYLE, new_style)
            SWP_NOMOVE = 0x0002
            SWP_NOSIZE  = 0x0001
            SWP_FRAMECHANGED = 0x0020
            ctypes.windll.user32.SetWindowPos(hwnd, 0, 0, 0, 0, 0,
                SWP_NOMOVE | SWP_NOSIZE | SWP_FRAMECHANGED)

    # --------------------------
    # Load and run GH definition.
    # --------------------------
    def load_and_run_definition(file_path):
        try:
            from Grasshopper.Kernel import GH_DocumentIO
            gh_io = GH_DocumentIO()
            if not gh_io.Open(file_path) or gh_io.Document is None:
                return None
            gh_doc = gh_io.Document
            gh_doc.NewSolution(False)
            return gh_doc
        except Exception:
            return None

    def display_document(gh_doc):
        try:
            doc_editor = Grasshopper.Instances.DocumentEditor
            if hasattr(doc_editor, "OpenDocument"):
                doc_editor.OpenDocument(gh_doc)
            else:
                Grasshopper.Instances.ActiveCanvas.Document = gh_doc
        except Exception:
            pass

    def hide_sensitive_content(gh_doc):
        visible_names = ["UI_Plus", "Dummy"]
        off_canvas = System.Drawing.PointF(-10000, -10000)
        for obj in gh_doc.Objects:
            try:
                if hasattr(obj, "NickName") and obj.NickName not in visible_names:
                    if hasattr(obj, "Attributes") and obj.Attributes is not None:
                        obj.Attributes.Pivot = off_canvas
                        if hasattr(obj.Attributes, "RecomputeBounds"):
                            obj.Attributes.RecomputeBounds()
                        if hasattr(obj.Attributes, "ExpireLayout"):
                            obj.Attributes.ExpireLayout()
            except Exception:
                pass
        gh_doc.NewSolution(False)

    # --------------------------
    # Optimized Idle Event Handler.
    # --------------------------
    last_visible_time = None

    def on_idle(sender, e):
        global last_visible_time
        hwnd = find_grasshopper_window()
        if hwnd:
            WS_VISIBLE = 0x10000000
            style = ctypes.windll.user32.GetWindowLongW(hwnd, -16)
            if style & WS_VISIBLE:
                if last_visible_time is None:
                    last_visible_time = time.time()
                elif time.time() - last_visible_time > 0.1:
                    minimize_grasshopper_window()
                    time.sleep(0.05)
                    hide_grasshopper_window_completely()
                    last_visible_time = None
            else:
                last_visible_time = None

    Rhino.RhinoApp.Idle += on_idle

    # --------------------------
    # Main Execution.
    # --------------------------
    file_path = download_gh_file()
    if not file_path:
        result = "Update and load ArchiTool failed: GH file download error."
    else:
        open_grasshopper_invisibly()
        gh_doc = load_and_run_definition(file_path)
        if gh_doc is None:
            result = "Update and load ArchiTool failed: GH file load error."
        else:
            display_document(gh_doc)
            hide_sensitive_content(gh_doc)
            minimize_grasshopper_window()
            hide_grasshopper_window_completely()
            result = "Update and load ArchiTool successful."
# ---------- end py3 ----------
python = GhPythonScript()  # -> out, a
# ---------- python: Python ----------
import sys

def check_ladybug_installed():
    try:
        # Attempt to import a Ladybug module
        import ladybug
        return "Ladybug is installed."
    except ImportError:
        return "Ladybug is not installed."

# Check for Ladybug installation
output = check_ladybug_installed()
print(output)
# ---------- end python ----------
panel_5 = Panel(python.out)
tab_2 = UITabbedLayout(Elements=flatten(rh_cmd_btn), Names=flatten(tab))
panel_6 = Panel("""Empowering the architectural community 
through innovative design tools, education, and practical applications""")
text_block_2 = UITextBlock(Text=panel_6)
link = Data(simplify(Tree({0}: ["https://raw.githubusercontent.com/yaha-coder/q321a21/main/0d7cde21/5fb423a3.gh"], {1}: ["https://raw.githubusercontent.com/yaha-coder/q321a21/main/a02c83a7/2fb7f924.gh"], {2}: ["https://raw.githubusercontent.com/yaha-coder/q321a21/main/db0e92ee/6a360cbe.gh"])))
panel_7 = Panel(rh_cmd_btn)
button = UiButton(Label=panel_2)
get_values_2 = UiValues(Element=button)
archidemy = LBEPWmap(x=get_values_2)  # -> out, a
# ---------- archidemy: Python ----------
import webbrowser as wb
import os

# URL to EPWmap.
url = 'https://archidemydoc.vercel.app/'

def mac_open(url):
    os.system("open \"\" " + url)

if x:  # _x is connected to a Boolean Toggle
    # Try to open the URL in a default browser.
    try:
        wb.open(url, 2, True)
        print('Opening EPWmap.')
    except Exception:
        mac_open(url)
else:
    print('Toggle is off. Set _epw_map to True to open EPWmap.')
# ---------- end archidemy ----------
# Buttons for Scripts
panel_8 = Panel("==============")
panel_9 = Panel("Site Analysis")
panel_10 = Panel("""0
0""")
spacer = UiSpacer(Width=10, Horizontal=False)
button_2 = UiButton(Label="Shadow Analysis3")
button_3 = UiButton(Label="Contact Us")
get_values_3 = UiValues(Element=button_3)
merge = Merge(Data1=flatten(button), Data2=flatten(button_3))
resize = UiResize(Element=merge, Alignment=list)
grid = UiGridLayout(Elements=merge, Columns=panel_3, Rows=panel_10)
archidemy_contact = LBEPWmap(x=get_values_3)  # -> out, a
# ---------- archidemy_contact: Python ----------
import webbrowser as wb
import os

# URL to EPWmap.
url = 'https://archidemydoc.vercel.app/contact'

def mac_open(url):
    os.system("open \"\" " + url)

if x:  # _x is connected to a Boolean Toggle
    # Try to open the URL in a default browser.
    try:
        wb.open(url, 2, True)
        print('Opening EPWmap.')
    except Exception:
        mac_open(url)
else:
    print('Toggle is off. Set _epw_map to True to open EPWmap.')
# ---------- end archidemy_contact ----------
toggle = BooleanToggle(True)
bang = ExplodeTree(Data=toggle)  # -> Branch0, Branch1
item = ListItem(List=flatten(bang.Branch0), Index=0, Wrap=True)
authorization_v3_0_limit_vercel = Python3Script(toggle=item)  # -> out, a
# ---------- authorization_v3_0_limit_vercel: Python ----------
import requests
import Rhino
from requests.exceptions import RequestException

# Node.js server URL
AUTH_URL = "https://architool-v3-server.vercel.app/authorize"

# Create a session for connection reuse
session = requests.Session()

def check_authorization(serial_number: str) -> (bool, str, int):
    """
    Checks authorization by querying the Node.js server with the given serial number.

    Parameters:
        serial_number (str): The Rhino serial number.
        
    Returns:
        tuple: (authorized (bool), message (str), remaining_uses (int))
    """
    try:
        response = session.get(AUTH_URL, params={'serialNumber': serial_number}, timeout=5)
        response.raise_for_status()  # Ensure we raise for bad HTTP responses
        
        data = response.json()
        authorized = data.get('authorized', False)
        message = data.get('message', "No message").strip()
        remaining_uses = data.get('remainingUses', 0)
        
        return authorized, message, remaining_uses
    except RequestException as req_err:
        print(f"Request error during authorization check: {req_err}")
    except ValueError as json_err:
        print(f"JSON parsing error: {json_err}")
    except Exception as e:
        print(f"Unexpected error during authorization check: {e}")
    
    return False, "Error: Could not connect to the server", 0

def process_authorization(toggle: bool) -> None:
    """
    Processes the authorization check based on the toggle value.

    Parameters:
        toggle (bool): If True, perform the authorization check; if False, skip it.
    """
    if not toggle:
        print("Toggle is set to False. Skipping authorization check.")
        print("0")
        return

    serial_number = Rhino.RhinoApp.SerialNumber
    is_authorized, message, remaining_uses = check_authorization(serial_number)

    if is_authorized:
        print("Active Educational License")
        print(f"Remaining Daily Uses: {remaining_uses}")
        print("1")
    elif "daily usage limit reached" in message.lower():
        print("Error: Daily limit for your educational license has been reached.")
        print("Please contact support at info@01Architecture.com for assistance.")
        print("3")
    else:
        print("Error: Unauthorized access.")
        print("Please check your license or contact support at info@01Architecture.com.")
        print("0")

if __name__ == "__main__":
    toggle = True  # Replace or set this value as needed
    process_authorization(toggle)
    print("01A_ArchiTools V3.0")
# ---------- end authorization_v3_0_limit_vercel ----------
item_2 = ListItem(List=authorization_v3_0_limit_vercel.out, Index=0, Wrap=True)  # -> Item2, Item1, Item
autorized = Data(item_2.Item2)
filter = StreamFilter(Gate=autorized, Stream1=rh_cmd_btn)  # disabled
pt = ConstructPoint(XCoordinate=Slider(75, range=0..200), YCoordinate=Slider(51, range=0..500), ZCoordinate=0)
panel_11 = Panel(authorization_v3_0_limit_vercel.out)
item_3 = ListItem(List=panel_11, Index=0, Wrap=True)  # -> Item1, Item, Item1_2
panel_12 = Panel(item_3.Item1_2)
concat = Concatenate(
    FragmentC=item_3.Item,
    FragmentD=panel_8,
    FragmentA=panel_5,
    FragmentH="==============",
    FragmentB=item_3.Item1,
    FragmentI=item_3.Item1_2)
panel_13 = Panel(concat)
log = Result(concat)
# Title
panel_14 = Panel(concat)
filter_2 = StreamFilter(Gate=autorized, Stream1=tab_2)
panel_15 = Panel("""Error: Unauthorized Access
The plugin cannot be activated with your current credentials. 
This feature is reserved exclusively for users with authorized access. 
If you would like to be added to the list of exclusive users, please Contact Us.
https://archidemydoc.vercel.app/contact""")
filter_3 = StreamFilter(Gate=autorized, Stream0=panel_15, Stream1=item_3.Item)
panel_16 = Panel(filter_3)
text_block_3 = UITextBlock(Text=panel_16)
merge_2 = Merge(Data1=flatten(text_block_2), Data2=flatten(text_block_3))
font_2 = UiSetFont(Element=merge_2, Family="Rajdhani")
merge_3 = Merge(Data1=flatten(text_block), Data2=flatten(merge_2), Data3=flatten(spacer), Data4=flatten(grid))
card = UiCardLayout(Elements=merge_3, Title="ArchiTool V3.0")
even_margin_padding = UiEvenMarginPadding(Element=card, Margin=Toggle(False), Distance=Slider(0, range=0..1000))
font_3 = UiSetFont(Element=text_block_3, Family="Rajdhani", Size=12, Bold=True)
merge_4 = Merge(Data1=flatten(text_block), Data2=flatten(text_block_2), Data3=flatten(text_block_3), Data4=flatten(grid))
merge_5 = Merge(Data1=flatten(merge_4), Data2=flatten(filter_2), Data3=flatten(filter))
merge_6 = Merge(Data1=flatten(card), Data2=flatten(spacer), Data3=flatten(merge_5))
window = UIWindow(Elements=merge_6, Title="ArchiTool V3.0", Owner=2, Scroll=Button(), Launch=toggle)
modify_win = UiModifyWindow(Window=window, Position=pt, HideControls=True, HideTitle=True)
